# Grasshopper definition Remap+Ranking_Internalised.gh (Grasshopper 1.0.7)
# plug-ins: Pufferfish

# Hexagon Curves
# Amenities
curve = Curve([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])
# Parks
# Public Transport
data = Data(Tree({1}: ["12", "12", "11", "8", "4", "3", "0", "0", "2", "9"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], {2}: ["2", "2", "2", "0", "0", "0", "0", "0", "0", "0"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], {3}: ["4", "4", "5", "11", "12", "12", "14", "14", "10", "7"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]))
data_2 = Data([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])
data_3 = Data(Tree({1}: ["0.301182", "0.342825", "0.284495", "0.181715", "0.146827", "0.05615"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], {2}: ["3405.991345", "3502.110836", "3814.623091", "4403.491978", "5186.850109", "5678.610205"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], {3}: ["3531.819902", "3717.218651", "4086.491918", "4472.188433", "5015.663582", "5691.043978"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], {4}: ["0.007689", "0.005114", "0.007488", "0.017117", "0.014787", "0.035047"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], {5}: ["0", "0", "0", "0", "0", "0"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], {6}: ["0.006931", "0.010971", "0.006773", "0.002435", "0.002337", "0.002865"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], {7}: ["7.811251", "7.944987", "0", "11.5579", "0", "0"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], {8}: ["0.02299", "0.034569", "0.023609", "0.010901", "0.010626", "0.004203"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]))
bounding_box = BoundingBox(Content=flatten(curve), Plane=PlaneXY(0, 0, 0), UnionBox=True)  # -> Box, Box_2
number_slider = Slider(0.09, range=0.01..0.1)
unit_y = UnitY(Factor=Slider(765, range=0..1000))
xz_plane = XZPlane(Origin=Point(0, 0, 0))
area = Area(Geometry=bounding_box.Box)  # -> Area, Centroid
panel = Panel(data_3)
panel_2 = Panel(data)
number_slider_2 = Slider(902, range=0..1000)
move = Move(Geometry=xz_plane, Motion=unit_y)  # -> Geometry, Transform
unit_x = UnitX(Factor=1)
scale = Scale(Geometry=data_2, Center=area.Centroid, Factor=number_slider)  # -> Geometry, Transform
scale_2 = Scale(Geometry=curve, Center=area.Centroid, Factor=number_slider)  # -> Geometry, Transform
series = Series(Start="1", Step=1, Count="8")
line_sdl = LineSDL(Start=move.Geometry, Direction=expr("-x", unit_x), Length=number_slider_2)
line_sdl_2 = LineSDL(Start=move.Geometry, Direction=unit_x, Length=number_slider_2)
orient = Orient(Geometry=scale.Geometry, Source=area.Centroid, Target=PlaneXY(0, 0, 0))  # -> Geometry, Transform
cull_index = CullIndex(List=series, Indices=expr("x-1", ["2", "3"]), Wrap=True)
join_curves = JoinCurves(Curves=[line_sdl_2, line_sdl], Preserve=False)
tree_branch = TreeBranch(Tree=data_3, Path=["3", "2"], MaintainPaths=True)
orient_2 = Orient(Geometry=scale_2.Geometry, Source=area.Centroid, Target=PlaneXY(0, 0, 0))  # -> Geometry, Transform
tree_branch_2 = TreeBranch(Tree=data_3, Path=cull_index, MaintainPaths=True)
panel_3 = Panel(tree_branch_2)
bounds = Bounds(Numbers=tree_branch)
length = Length(Curve=join_curves)
deconstruct_domain = DeconstructDomain(Domain=bounds)  # -> Start, End
# Analysis Data for Graphs
data_4 = Data(Tree({1}: ["0", "1", "2", "30.1182", "0", "1", "1", "1", "0", "0", "0", "0", "1", "2", "0", "2", "3", "0", "1", "0", "1302", "3720", "18.6"], {2}: ["0", "2", "2", "34.2825", "0", "2", "1", "2", "1", "0", "0", "0", "0", "1", "0", "2", "2", "0", "1", "0", "3164", "9040", "45.2"], {3}: ["0", "2", "3", "28.4495", "0", "2", "1", "2", "1", "0", "0", "0", "0", "1", "0", "2", "1", "0", "1", "0", "1428", "4080", "20.4"], {4}: ["0", "1", "5", "18.1715", "0", "2", "1", "1", "1", "0", "0", "0", "0", "1", "0", "1", "0", "0", "1", "0", "504", "1440", "7.2"], {5}: ["0", "1", "7", "14.6827", "0", "1", "0", "1", "1", "0", "0", "0", "0", "0", "0", "1", "0", "0", "0", "0", "224", "640", "3.2"], {6}: ["0", "1", "6", "5.615", "0", "1", "0", "1", "1", "0", "0", "0", "0", "0", "0", "0", "0", "0", "0", "0", "112", "320", "1.6"]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))
replace_nulls = ReplaceNulls(Items=tree_branch_2, Replacements="0")  # -> Items, Count
construct_domain = ConstructDomain(DomainStart=deconstruct_domain.End, DomainEnd=deconstruct_domain.Start)
panel_4 = Panel("""2
1
1
16
3""")
panel_5 = Panel(panel_4)
list_length = ListLength(List=panel_5)  # -> expr("x-1", Length)
repeat_data = RepeatData(Data="2", Length=list_length)
weave = Weave(Pattern=[0, 1], Stream0=panel_5, Stream1=repeat_data, NullGaps=False)
bounds_2 = Bounds(Numbers=replace_nulls.Items)
panel_6 = Panel(weave)
mass_addition = MassAddition(Input=panel_6)  # -> Result, PartialResults
remap_numbers = RemapNumbers(Value=tree_branch, Source=construct_domain, Target=Domain(0, 1))  # -> Mapped, Clipped
remap_numbers_2 = RemapNumbers(Value=tree_branch_2, Source=bounds_2, Target=Domain(0, 1))  # -> Mapped, Clipped
panel_7 = Panel(bounds_2)
division = Division(A=length, B=mass_addition.Result)
panel_8 = Panel(remap_numbers_2.Mapped)
divide_length = DivideLength(Curve=join_curves, Length=division)  # -> Points, Tangents, Parameters
flip_matrix = FlipMatrix(Data=remap_numbers.Mapped)
flip_matrix_2 = FlipMatrix(Data=remap_numbers_2.Mapped)
merge = Merge(Data1=flip_matrix, Data2=flip_matrix_2)
shatter = Shatter(Curve=join_curves, Parameters=divide_length.Parameters)
partition_list = PartitionList(List=shatter, Size=panel_6)  # -> simplify(Chunks)
mass_addition_2 = MassAddition(Input=merge)  # -> flatten(Result), PartialResults
param_viewer = ParamViewer(partition_list)
bounds_3 = Bounds(Numbers=mass_addition_2.Result)
dispatch = Dispatch(List=param_viewer, DispatchPattern=[True, False])  # -> ListA, ListB
unit_z = UnitZ(Factor=Slider(50, range=0..100))
quick_graph = QuickGraph(mass_addition_2.Result, SortOrder=0)
xy_plane = XYPlane(Origin=Point(0, 0, 0))
remap_numbers_3 = RemapNumbers(Value=mass_addition_2.Result, Source=bounds_3, Target=Domain(0, 1))  # -> Mapped, Clipped
region_union = RegionUnion(Curves=orient.Geometry, Plane=xy_plane)
tree_branch_3 = TreeBranch(Tree=partition_list, Path=dispatch.ListA, MaintainPaths=True)
# Preview the classification
graph_mapper = GraphMapper(remap_numbers_3.Mapped, x0=0, x1=1, y0=0, y1=1, container_name="Bezier", cpx=[0, 0.8399885893, 0, 1], cpy=[0, 0, 1, 1])
join_curves_2 = JoinCurves(Curves=tree_branch_3, Preserve=False)  # -> simplify(Curves)
length_2 = Length(Curve=join_curves_2)  # -> flatten(Length)
expression = Expression(x=length_2, Expression="-x/2")
expression_2 = Expression(x=length_2, Expression="x/2")
construct_domain_2 = ConstructDomain(DomainStart=expression, DomainEnd=expression_2)
gradient = Gradient(LowerLimit=0, UpperLimit=1, Parameter=graph_mapper, stops=[0: RGB(0, 128, 0), 0.5: RGB(255, 255, 0), 1: RGB(255, 0, 0)])
curve_2 = Curve(orient_2.Geometry)
area_2 = Area(Geometry=curve_2)  # -> Area, Centroid
curve_middle = CurveMiddle(Curve=join_curves_2)
orient_3 = Orient(Geometry=xz_plane, Source=PlaneXY(0, 0, 0), Target=curve_middle)  # -> flatten(Geometry), Transform
move_2 = Move(Geometry=orient_3.Geometry, Motion=unit_z)  # -> Geometry, Transform
rectangle = Rectangle(Plane=move_2.Geometry, XSize=construct_domain_2, YSize=Slider(243, range=0..1000), Radius=0)  # -> Rectangle, Length
explode = Explode(Curve=rectangle.Rectangle, Recursive=True)  # -> Segments, Vertices
surface = Surface(curve_2)
list_item = ListItem(List=explode.Segments, Index=0, Wrap=True)  # -> Item1, Item
divide_curve = DivideCurve(Curve=list_item.Item, Count=expr("x-1", graft(panel_4)), Kinks=False)  # -> simplify(Points), Tangents, Parameters
area_3 = Area(Geometry=surface)  # -> Area, Centroid
curve_middle_2 = CurveMiddle(Curve=list_item.Item)
null_item = NullItem(Item=divide_curve.Points)  # -> NullFlags, InvalidFlags, Description
dispatch_2 = Dispatch(List=curve_middle_2, DispatchPattern=null_item.NullFlags)  # -> ListA, ListB
merge_2 = Merge(Data1=divide_curve.Points, Data2=simplify(dispatch_2.ListA))
xz_plane_2 = XZPlane(Origin=merge_2)
number_slider_3 = Slider(725, range=0..1000)  # disabled
number_slider_4 = Slider(245, range=0..1000)  # disabled
xy_plane_2 = XYPlane(Origin=Point(0, 0, 0))  # disabled
construct_point = ConstructPoint(XCoordinate=number_slider_3, YCoordinate=expr("-X", number_slider_4), ZCoordinate=0)  # disabled
rangevalue3 = Slider(2, range=1..10)
rangevalue = Slider(1000, range=0..1000)
rangevalue1 = Slider(2045, range=2000..2050)
rangevalue2 = Slider(0, range=0..5)
number = Number(0.1)
panel_9 = Panel("""1
6
9
8
10
8""")  # disabled
move_3 = Move(Geometry=xy_plane_2, Motion=construct_point)  # -> Geometry, Transform; disabled
text = Text(["school", "store", "market", "public_building", "mall", "library", "university", "parking", "hospital", "clinic", "theatre", "restaurant", "office", "government", "parks", "public transport"])
# Amenities per capita
panel_10 = Panel("2020")
number_slider_5 = Slider(718, range=0..1000)  # disabled
rangevalue3_2 = GetNumber(rangevalue3, AtLeast=1, AtMost=2147483647, Maximum=1.797693135e+308, Minimum=-1.797693135e+308)
panel_11 = Panel("""Number of existing urban parks with >1000m2
 in a range of 1000m radius""")
# Year of Prediction
rangevalue_2 = GetNumber(rangevalue, AtLeast=1, AtMost=2147483647, Maximum=1.797693135e+308, Minimum=-1.797693135e+308)
rangevalue1_2 = GetNumber(rangevalue1, AtLeast=1, AtMost=2147483647, Maximum=1.797693135e+308, Minimum=-1.797693135e+308)
panel_12 = Panel(text)
number_2 = Number(expr("X-1999", panel_10))
number_3 = Number(expr("X-1999", rangevalue1_2))
rangevalue2_2 = GetNumber(rangevalue2, AtLeast=1, AtMost=2147483647, Maximum=1.797693135e+308, Minimum=-1.797693135e+308)
list_item_2 = ListItem(List=panel_9, Index=rangevalue2_2, Wrap=True)  # disabled
number_4 = Number(Tree({1}: [13.608772, 25.026316, 0.272544, 9.101754, 548323.0877, 6.52193, 2.601754, 2403.192982, 39.247368, 452.57193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], {2}: [13.441579, 26.713158, 0.2706, 9.236316, 545987.6105, 6.486842, 2.466316, 2411.415789, 37.614737, 454.726842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], {3}: [13.274386, 28.4, 0.268656, 9.370877, 543652.1333, 6.451754, 2.330877, 2419.638596, 35.982105, 456.881754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], {4}: [13.107193, 30.086842, 0.266712, 9.505439, 541316.6561, 6.416667, 2.195439, 2427.861404, 34.349474, 459.036667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], {5}: [12.94, 31.773684, 0.264768, 9.64, 538981.1789, 6.381579, 2.06, 2436.084211, 32.716842, 461.191579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], {6}: [12.772807, 33.460526, 0.262825, 9.774561, 536645.7018, 6.346491, 1.924561, 2444.307018, 31.084211, 463.346491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]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))
flip_matrix_3 = FlipMatrix(Data=number_4)  # disabled
multiplication = Multiplication(A=rangevalue3_2, B=number)
smaller_than = SmallerThan(FirstNumber=graph_mapper, SecondNumber=multiplication)  # -> SmallerThan, OrEqualTo
dispatch_3 = Dispatch(List=surface, DispatchPattern=smaller_than.SmallerThan)  # -> ListA, ListB
surface_2 = Surface(dispatch_3.ListA)
area_4 = Area(Geometry=surface_2)  # -> Area, Centroid
# The least score hexagons
point_in_curve = PointInCurve(Point=area_4.Centroid, Curve=region_union)  # -> Relationship, Point
dispatch_4 = Dispatch(List=surface_2, DispatchPattern=point_in_curve.Relationship)  # -> ListA, ListB
surface_3 = Surface(dispatch_4.ListA)
area_5 = Area(Geometry=surface_3)  # -> Area, Centroid
closest_point = ClosestPoint(Point=area_5.Centroid, Cloud=area_2.Centroid)  # -> ClosestPoint, CPIndex, Distance
tree_branch_4 = TreeBranch(Tree=merge, Path=closest_point.CPIndex, MaintainPaths=True)

# ---- group: RH_OUT:LeastScore
curve_3 = Curve(surface_3)

# ----
# Metric Number
division_2 = Division(A=rangevalue_2, B=Slider(10, range=0..100))
panel_13 = Panel("""Office Area per person
Residential Area per person
Logistics Area per person""")
panel_14 = Panel("""Schools
Universities""")
rectangle_2 = Rectangle(Plane=move_3.Geometry, XSize=number_slider_5, YSize=number_slider_5, Radius=0)  # -> Rectangle, Length; disabled
panel_15 = Panel(rangevalue3_2)
tree_branch_5 = TreeBranch(Tree=number_4, Path=number_2, MaintainPaths=True)
tree_branch_6 = TreeBranch(Tree=number_4, Path=number_3, MaintainPaths=True)
tree_branch_7 = TreeBranch(Tree=flip_matrix_3, Path=list_item_2, MaintainPaths=True)  # disabled
merge_3 = Merge(Data1="EDUCATION", Data2="PUBLIC PARKS", Data3="BUILT AREA", Data4="URBAN AMENITIES", Data5="LAND USE")
merge_4 = Merge(
    Data1="Number of Educational institutes within 1000m radius",
    Data2=panel_11,
    Data3="% in a range of 1000m radius",
    Data4="Existing and lacking",
    Data5="Use and program ratio")
unit_z_2 = UnitZ(Factor=Slider(25, range=0..100))
bounds_4 = Bounds(Numbers=tree_branch_7)  # disabled
explode_2 = Explode(Curve=rectangle_2.Rectangle, Recursive=True)  # -> Segments, Vertices; disabled
unit_z_3 = UnitZ(Factor=Slider(24, range=0..100))

panel_16 = Panel(tree_branch_5)
panel_17 = Panel(tree_branch_6)

# ----
# Keshava's Metrics
# Pedro's Metrics
# ML Prediction
# Mass to void ratio in hexagon
# Closest distance to healthcare
# Closest distance to Parks
# number of education facilities per capita
# Area of Green Space per capita
# Area of commercial to residential in a hexagon
# Population density in hexagon
panel_18 = Panel("""Hospital_beds_per_1000
Green_Energy_produced
Investment_Heath_GDP
Newborns
Population
Poverty_rate
Price_Index
Road_Accidents_yr
School_leavers_rate
Transportation_metro
Solid_waste_collection""")
split_list = SplitList(List=panel_16, Index="11")  # -> ListA, ListB
split_list_2 = SplitList(List=panel_17, Index="11")  # -> ListA, ListB
panel_19 = Panel(split_list.ListA)
panel_20 = Panel(split_list_2.ListA)

number_slider_6 = Slider(11, range=0..100)
unit_z_4 = UnitZ(Factor=Slider(13, range=0..100))
remap_numbers_4 = RemapNumbers(Value=tree_branch_7, Source=bounds_4, Target=Domain(0, 1))  # -> Mapped, Clipped; disabled
list_item_3 = ListItem(List=explode_2.Segments, Index=0, Wrap=True)  # -> Item1, Item; disabled
entwine = Entwine(Branch00=panel_14, Branch03=panel_12, Branch04=panel_13, FlattenInputs=True)  # -> simplify(Result)
number_slider_7 = Slider(525, range=0..1000)  # disabled
move_4 = Move(Geometry=orient_3.Geometry, Motion=unit_z_3)  # -> Geometry, Transform
flip_plane = FlipPlane(Plane=orient_3.Geometry, ReverseX=invert(False), ReverseY=invert(False), SwapAxes=invert(True))
list_length_2 = ListLength(List=remap_numbers_4.Mapped)  # disabled
flip_plane_2 = FlipPlane(Plane=move_4.Geometry, ReverseX=invert(False), ReverseY=invert(False), SwapAxes=invert(True))
divide_curve_2 = DivideCurve(Curve=list_item_3.Item, Count=list_length_2, Kinks=False)  # -> Points, Tangents, Parameters; disabled
unit_y_2 = UnitY(Factor=1)  # disabled
multiplication_2 = Multiplication(A=remap_numbers_4.Mapped, B=number_slider_7)  # disabled
line_sdl_3 = LineSDL(Start=divide_curve_2.Points, Direction=unit_y_2, Length=multiplication_2)  # disabled
end_points = EndPoints(Curve=line_sdl_3)  # -> Start, End; disabled
polyline = PolyLine(Vertices=end_points.End, Closed=False)  # disabled
# 0. Change in Green Space for each hexagon
# 1. Change in Ratio of Amenities per hexagon
# 2. Change in Public Transport per hexagon
point = Point(Point(388.1235616, 64.58653509, 0))
surface_4 = Surface(curve_2)
point_2 = GetPoint(point, AtLeast=1, AtMost=2147483647, Realtime=True)
area_6 = Area(Geometry=surface_4)  # -> Area, Centroid
circle = Circle(Plane=point_2, Radius=division_2)
# Select this to move the point
# across the city map
panel_21 = Panel(point)
closest_point_2 = ClosestPoint(Point=point_2, Cloud=area_6.Centroid)  # -> ClosestPoint, CPIndex, Distance
number_5 = Number(expr("x+1", closest_point_2.CPIndex))
tree_branch_8 = TreeBranch(Tree=data_4, Path=number_5, MaintainPaths=True)
partition_list_2 = PartitionList(List=tree_branch_8, Size=panel_4)  # -> simplify(Chunks)
param_viewer_2 = ParamViewer(partition_list_2)  # disabled
list_item_4 = ListItem(List=param_viewer_2, Index=0, Wrap=True)  # -> Item, Item1, Item2, Item3, Item4; disabled
# AMENITIES
tree_branch_9 = TreeBranch(Tree=partition_list_2, Path=list_item_4.Item3, MaintainPaths=True)  # disabled
# LAND USE
tree_branch_10 = TreeBranch(Tree=partition_list_2, Path=list_item_4.Item4, MaintainPaths=True)  # disabled
# EDUCATION
tree_branch_11 = TreeBranch(Tree=partition_list_2, Path=list_item_4.Item, MaintainPaths=True)  # disabled
# PARKS
tree_branch_12 = TreeBranch(Tree=partition_list_2, Path=list_item_4.Item1, MaintainPaths=True)  # disabled
# BUILT %
tree_branch_13 = TreeBranch(Tree=partition_list_2, Path=list_item_4.Item2, MaintainPaths=True)  # disabled
bounds_5 = Bounds(Numbers=partition_list_2)
remap_numbers_5 = RemapNumbers(Value=partition_list_2, Source=bounds_5, Target=Domain(0, 1))  # -> Mapped, Clipped
multiplication_3 = Multiplication(A=remap_numbers_5.Mapped, B=Slider(175, range=0..1000))
rectangle_3 = Rectangle(Plane=xz_plane_2, XSize=Slider(14, range=0..100), YSize=multiplication_3, Radius=0)  # -> Rectangle, Length
area_7 = Area(Geometry=rectangle_3.Rectangle)  # -> Area, Centroid
equality = Equality(FirstNumber=area_7.Area, SecondNumber="0")  # -> Equality, Inequality
tree_statistics = TreeStatistics(Tree=rectangle_3.Rectangle)  # -> Paths, Length, Count
dispatch_5 = Dispatch(List=rectangle_3.Rectangle, DispatchPattern=equality.Equality)  # -> ListA, ListB
panel_22 = Panel(equality.Equality)
member_index = MemberIndex(Set=panel_22, Member="True")  # -> Index, Count
mass_addition_3 = MassAddition(Input=tree_statistics.Length)  # -> Result, PartialResults
surface_5 = Surface(dispatch_5.ListB)
insert_items = InsertItems(List=surface_5, Indices=member_index.Index, Wrap=True)
list_indices = ListIndices(List=flatten(insert_items))
gradient_2 = Gradient(
    LowerLimit=0,
    UpperLimit=expr("x-1", mass_addition_3.Result),
    Parameter=list_indices,
    stops=[0: RGB(243, 57, 0), 0.1: RGB(236, 27, 60), 0.2: RGB(210, 0, 118), 0.3: RGB(103, 0, 120), 0.4: RGB(39, 72, 161), 0.5: RGB(1, 192, 229), 0.6: RGB(18, 178, 90), 0.7: RGB(79, 186, 8), 0.8: RGB(220, 237, 32), 0.9: RGB(247, 159, 20), 1: RGB(243, 57, 0)])
flatten_tree = FlattenTree(Tree=insert_items, Path="{0}")  # -> graft(Tree)
explode_3 = Explode(Curve=rectangle_3.Rectangle, Recursive=True)  # -> Segments, Vertices
mesh_colours = MeshColours(Mesh=flatten_tree, Colours=simplify(graft(gradient_2)))
list_item_5 = ListItem(List=explode_3.Segments, Index=0, Wrap=True)  # -> Item, Item1, Item2
tree_branch_14 = TreeBranch(Tree=dispatch_5.ListA, Path="3", MaintainPaths=True)
curve_middle_3 = CurveMiddle(Curve=tree_branch_14)
curve_middle_4 = CurveMiddle(Curve=list_item_5.Item2)
line_sdl_4 = LineSDL(Start=curve_middle_3, Direction=Vector(0, 0, 1), Length=Slider(343, range=0..1000))
move_5 = Move(Geometry=curve_middle_4, Motion=unit_z_2)  # -> Geometry, Transform
xz_plane_3 = XZPlane(Origin=move_5.Geometry)
trim_tree = TrimTree(Tree=xz_plane_3, Depth=1)
flip_plane_3 = FlipPlane(Plane=trim_tree, ReverseX=invert(False), ReverseY=False, SwapAxes=True)
move_6 = Move(Geometry=flip_plane_3, Motion=unit_z_4)  # -> Geometry, Transform
flip_plane_4 = FlipPlane(Plane=xz_plane_3, ReverseX=invert(False), ReverseY=invert(False), SwapAxes=invert(True))

# ---- group: RH_OUT:Mesh1
mesh = Mesh(mesh_colours)

# ----
list_item_6 = ListItem(List=curve_2, Index=closest_point_2.CPIndex, Wrap=True)
# Pedro's Metric
pedro_s_metric = Slider(10, range=0..10)
# Pedro's Metric
pedro_s_metric_2 = Slider(8, range=0..10)

# ---- group: RH_OUT:hex
# Selected Hexagon
crv = Curve(list_item_6)

# ----
# Pedro's Metric
pedro_s_metric_3 = Slider(1, range=0..10)
pedro_s_metric_4 = Slider(6, range=0..10)
# Keshava's Metric
number_slider_8 = Slider(3, range=0..10)
# Pedro's Metric
pedro_s_metric_5 = Slider(9, range=0..10)
# Pedro's Metric
pedro_s_metric_6 = Slider(3, range=0..10)
tree_branch_15 = TreeBranch(Tree=data_3, Path="8", MaintainPaths=False)
list_item_7 = ListItem(List=split_list_2.ListA, Index=pedro_s_metric_2, Wrap=True)
list_item_8 = ListItem(List=merge, Index=Slider(4, range=0..10), Wrap=True)
list_item_9 = ListItem(List=panel_19, Index=pedro_s_metric_2, Wrap=True)
list_item_10 = ListItem(List=split_list_2.ListA, Index=pedro_s_metric, Wrap=True)
number_6 = Number(101826.6346)
list_item_11 = ListItem(List=panel_19, Index=pedro_s_metric, Wrap=True)
multiplication_4 = Multiplication(A=tree_branch_15, B=number_6)
division_3 = Division(A=list_item_7, B=list_item_9)
panel_23 = Panel(list_item_10)
list_item_12 = ListItem(List=panel_19, Index=pedro_s_metric_4, Wrap=True)
list_item_13 = ListItem(List=split_list_2.ListA, Index=pedro_s_metric_4, Wrap=True)
list_item_14 = ListItem(List=merge, Index=number_slider_8, Wrap=True)
flip_matrix_4 = FlipMatrix(Data=data)
list_item_15 = ListItem(List=panel_19, Index=pedro_s_metric_5, Wrap=True)
list_item_16 = ListItem(List=split_list_2.ListA, Index=pedro_s_metric_5, Wrap=True)
round = Round(Number=multiplication_4)  # -> Nearest, Floor, Ceiling
division_4 = Division(A=list_item_10, B=list_item_11)
list_item_17 = ListItem(List=split_list_2.ListA, Index=pedro_s_metric_3, Wrap=True)
list_item_18 = ListItem(List=merge, Index=Slider(5, range=0..10), Wrap=True)
list_item_19 = ListItem(List=panel_19, Index=pedro_s_metric_3, Wrap=True)
panel_24 = Panel(list_item_14)
division_5 = Division(A=list_item_16, B=list_item_15)
division_6 = Division(A=list_item_13, B=list_item_12)
list_item_20 = ListItem(List=split_list_2.ListA, Index=pedro_s_metric_6, Wrap=True)
list_item_21 = ListItem(List=panel_19, Index=pedro_s_metric_6, Wrap=True)
list_item_22 = ListItem(List=flip_matrix_4, Index=Slider(2, range=0..2), Wrap=True)
multiplication_5 = Multiplication(A=division_3, B=list_item_8)
number_7 = Number(simplify(graft(round.Nearest)))
division_7 = Division(A=list_item_17, B=list_item_19)
division_8 = Division(A=list_item_20, B=list_item_21)
multiplication_6 = Multiplication(A=division_6, B=panel_24)
tree_branch_16 = TreeBranch(Tree=list_item_22, Path=closest_point.CPIndex, MaintainPaths=True)
# Population per hexagon
panel_25 = Panel(round.Nearest)
bounds_6 = Bounds(Numbers=panel_25)
multiplication_7 = Multiplication(A=division_7, B=list_item_18)
multiplication_8 = Multiplication(A=division_8, B="23")
multiplication_9 = Multiplication(A=division_5, B=tree_branch_16)
bounds_7 = Bounds(Numbers=flatten(panel_25))
remap_numbers_6 = RemapNumbers(Value=panel_25, Source=bounds_6, Target=Domain(0, 1))  # -> Mapped, Clipped
number_8 = Number(rangevalue2_2)
# Predicted Increase / Decrease in green space for every 1 sq.km
# Predicted Increase / Decrease in Ratio of Amenities every 1 sq.km
# Predicted Increase / Decrease in Public Transport every 1 sq.km
# Predicted Increase in Educational Facilities for every 1 sq.km
# Predicted Increase / Decrease in Solid Waste Generation for every 1 sq.km
# Predicted Increase / Decrease in Population density per hexagon for every 1 sq.km
text_2 = Text(["Predicted Increase / Decrease in green space for every 1 sq.km", "Predicted Increase / Decrease in Ratio of Amenities every 1 sq.km", "Predicted Increase / Decrease in Public Transport every 1 sq.km", "Predicted Increase in Educational Facilities for every 1 sq.km", "Predicted Increase / Decrease in Solid Waste Generation for every 1 sq.km", "Predicted Increase / Decrease in Population density per hexagon for every 1 sq.km"])
# Predicted Increase in Educational Facilities pre Capita
panel_26 = Panel(multiplication_5)
number_slider_9 = Slider(750, range=0..1000)
subtraction = Subtraction(A=multiplication_8, B="23")
list_item_23 = ListItem(List=text_2, Index=number_8, Wrap=True)
# Predicted Increase in Green Space pre Capita
panel_27 = Panel(multiplication_7)
remap_numbers_7 = RemapNumbers(Value=flatten(panel_25), Source=bounds_7, Target=Domain(0, 1))  # -> Mapped, Clipped
# Predicted Ratio of Amenities per Capita
panel_28 = Panel(multiplication_6)
# Pred number of Public Transport
panel_29 = Panel(multiplication_9)
multiplication_10 = Multiplication(A=division_4, B=remap_numbers_6.Mapped)
panel_30 = Panel("  //     ")
number_slider_10 = Slider(1000, range=0..1000)
mass_addition_4 = MassAddition(Input=multiplication_10)  # -> Result, PartialResults
text_3 = Text("  //     ")
graph_mapper_2 = GraphMapper(remap_numbers_7.Mapped, x0=0, x1=1, y0=0, y1=1, container_name="Sigmoid-Logits", e=0.2467943281, t0=-100, t1=100)
# Change in Requirement of Hospitals
panel_31 = Panel(subtraction)
construct_point_2 = ConstructPoint(XCoordinate=number_slider_9, YCoordinate=0, ZCoordinate=0)
subtraction_2 = Subtraction(A=panel_26, B=list_item_8)
multiplication_11 = Multiplication(A=mass_addition_4.Result, B=number_slider_10)
# Change in Green Space per Capita
subtraction_3 = Subtraction(A=panel_27, B=list_item_18)
subtraction_4 = Subtraction(A=panel_29, B=list_item_22)
data_5 = Data(graph_mapper_2)
# Change in Ratio of Amenities per Capita
subtraction_5 = Subtraction(A=panel_28, B=panel_24)
panel_32 = Panel(subtraction_2)
panel_33 = Panel(subtraction_3)
panel_34 = Panel(multiplication_11)
panel_35 = Panel(subtraction_5)
gradient_3 = Gradient(LowerLimit=0, UpperLimit=1, Parameter=graph_mapper_2, stops=[0.289: RGBA(255, 233, 212, 0), 0.85: RGB(255, 128, 0)])
rectangle_4 = Rectangle(Plane=construct_point_2, XSize=Slider(207, range=0..1000), YSize=Slider(30, range=0..100), Radius=0)  # -> Rectangle, Length
multiplication_12 = Multiplication(A=multiplication_10, B=number_slider_10)  # -> simplify(graft(Result))
multiplication_13 = Multiplication(A=simplify(graft(round.Nearest)), B=panel_35)
multiplication_14 = Multiplication(A=simplify(graft(round.Nearest)), B=panel_32)  # -> simplify(Result)
multiplication_15 = Multiplication(A=simplify(graft(round.Nearest)), B=panel_33)
explode_4 = Explode(Curve=rectangle_4.Rectangle, Recursive=True)  # -> Segments, Vertices
# Solid Waste Generation
panel_36 = Panel(multiplication_12)
# -- Analysis Title
panel_37 = Panel("Arial")
deconstruct_brep = DeconstructBrep(Brep=rectangle_4.Rectangle)  # -> Faces, Edges, Vertices
# Change in Ratio of Amenities per hexagon
panel_38 = Panel(multiplication_13)
# Change in Public Transport
panel_39 = Panel(subtraction_4)
# Change in Green Space for each hexagon
panel_40 = Panel(multiplication_15)
unit_y_3 = UnitY(Factor=expr("-x", 1))
text_4 = Text("Arial")
# Predicted Increase in Educational Facilities for each hexagon
panel_41 = Panel(multiplication_14)
list_item_24 = ListItem(List=deconstruct_brep.Edges, Index=0, Wrap=True)
list_item_25 = ListItem(List=explode_4.Segments, Index=0, Wrap=True)  # -> Item, Item1, Item2
unit_y_4 = UnitY(Factor=Slider(31, range=0..100))
point_on_curve = PointOnCurve(list_item_25.Item2, parameter=0.971)
bounds_8 = Bounds(Numbers=flatten(panel_36))
bounds_9 = Bounds(Numbers=flatten(panel_40))
round_to_decimal_place = RoundToDecimalPlace(NumberX=panel_38, DecimalPlace="2", RoundType=0)  # -> Rounded, Difference
bounds_10 = Bounds(Numbers=flatten(panel_39))
move_7 = Move(Geometry=list_item_24, Motion=unit_y_3)  # -> Geometry, Transform
bounds_11 = Bounds(Numbers=flatten(panel_41))
move_8 = Move(Geometry=point_on_curve, Motion=unit_y_4)  # -> Geometry, Transform
data_6 = Data(gradient_3)
remap_numbers_8 = RemapNumbers(Value=flatten(panel_39), Source=bounds_10, Target=Domain(0, 1))  # -> Mapped, Clipped
remap_numbers_9 = RemapNumbers(Value=flatten(panel_36), Source=bounds_8, Target=Domain(0, 1))  # -> Mapped, Clipped
remap_numbers_10 = RemapNumbers(Value=flatten(panel_40), Source=bounds_9, Target=Domain(0, 1))  # -> Mapped, Clipped
bounds_12 = Bounds(Numbers=flatten(round_to_decimal_place.Rounded))
remap_numbers_11 = RemapNumbers(Value=flatten(panel_41), Source=bounds_11, Target=Domain(0, 1))  # -> Mapped, Clipped
slider = Slider(11, range=0..11)
end_points_2 = EndPoints(Curve=move_7.Geometry)  # -> Start, End
data_7 = Data(Tree({0}: ["Santo António"], {1}: ["Parque das Nações"], {2}: ["Marvila"], {3}: ["Ajuda"], {4}: ["Areeiro"], {5}: ["Santa Maria Maior"]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))

# ----
# Pedro's metrics
number_9 = Number(split_list_2.ListB)
number_10 = Number(split_list.ListB)
panel_42 = Panel(number_9)
panel_43 = Panel(number_10)
bounds_13 = Bounds(Numbers=panel_42)
bounds_14 = Bounds(Numbers=panel_43)
construct_domain_3 = ConstructDomain(DomainStart=0, DomainEnd="14")
construct_domain_4 = ConstructDomain(DomainStart=0, DomainEnd="14")
remap_numbers_12 = RemapNumbers(Value=panel_42, Source=bounds_13, Target=construct_domain_3)  # -> Mapped, Clipped
remap_numbers_13 = RemapNumbers(Value=panel_43, Source=bounds_14, Target=construct_domain_4)  # -> Mapped, Clipped
sort_text = SortText(Keys=flatten(data_7), Values=flatten(orient.Geometry), Culture=127)  # -> Keys, Values
panel_44 = Panel(remap_numbers_13.Mapped)
panel_45 = Panel(remap_numbers_12.Mapped)
surface_6 = Surface(sort_text.Values)
area_8 = Area(Geometry=surface_6)  # -> Area, Centroid
mass_addition_5 = MassAddition(Input=panel_44)  # -> Result, PartialResults
closest_point_3 = ClosestPoint(Point=point, Cloud=area_8.Centroid)  # -> ClosestPoint, CPIndex, Distance
gradient_4 = Gradient(
    LowerLimit=0,
    UpperLimit="14",
    Parameter=panel_45,
    stops=[0: RGB(234, 38, 0), 0.25: RGB(103, 135, 191), 0.5: RGB(254, 244, 84), 0.75: RGB(255, 128, 0), 1: RGB(255, 0, 0)])
mass_addition_6 = MassAddition(Input=panel_45)  # -> Result, PartialResults
panel_46 = Panel(mass_addition_5.Result)
list_item_26 = ListItem(List=sort_text.Keys, Index=closest_point_3.CPIndex, Wrap=True)  # -> flatten(Item)
# METRIC
panel_47 = Panel(mass_addition_6.Result)
panel_48 = Panel(list_item_26)

panel_49 = Panel(number_9)
round_to_decimal_place_2 = RoundToDecimalPlace(NumberX=panel_49, DecimalPlace="1", RoundType=0)  # -> Rounded, Difference
graph_mapper_3 = GraphMapper(remap_numbers_8.Mapped, x0=0, x1=1, y0=0, y1=1, container_name="Sigmoid-Logits", e=0.7139804363, t0=-100, t1=100)
data_8 = Data(graph_mapper_3)
graph_mapper_4 = GraphMapper(remap_numbers_9.Mapped, x0=0, x1=1, y0=0, y1=1, container_name="Sigmoid-Logits", e=0.2467943281, t0=-100, t1=100)
data_9 = Data(graph_mapper_4)
graph_mapper_5 = GraphMapper(remap_numbers_10.Mapped, x0=0, x1=1, y0=0, y1=1, container_name="Sigmoid-Logits", e=0.2467943281, t0=-100, t1=100)
data_10 = Data(graph_mapper_5)
text_5 = Text("Arial")
boolean = Boolean(False)
number_slider_11 = Slider(26, range=0..100)
graph_mapper_6 = GraphMapper(remap_numbers_11.Mapped, x0=0, x1=1, y0=0, y1=1, container_name="Sigmoid-Logits", e=0.2467943281, t0=-100, t1=100)
data_11 = Data(graph_mapper_6)
panel_50 = Panel("least")
panel_51 = Panel("most")
# METRIC4
# Predicted Increase / Decrease in Solid Waste Generation
# METRIC5
# Population density per hexagon
gradient_5 = Gradient(
    LowerLimit=0,
    UpperLimit=1,
    Parameter=graph_mapper_4,
    stops=[0.138: RGB(255, 255, 255), 0.307: RGB(255, 255, 255), 0.542: RGB(79, 55, 25)])
data_12 = Data(gradient_5)
remap_numbers_14 = RemapNumbers(Value=flatten(round_to_decimal_place.Rounded), Source=bounds_12, Target=Domain(0, 1))  # -> Mapped, Clipped
c_script = CSharpScript(face=text_5, bold=boolean, size=slider, content="least", pl=end_points_2.Start)  # -> out, A; inputs face: String, bold: Boolean, italics: Boolean, size: Double, content: String, pl: Plane
# ---------- c_script: C# usings ----------
using System.IO;
using System.Linq;
using System.Data;
using System.Drawing;
using System.Reflection;
using System.Windows.Forms;
using System.Xml;
using System.Xml.Linq;
using System.Runtime.InteropServices;

using Rhino.DocObjects;
using Rhino.Collections;
using GH_IO;
using GH_IO.Serialization;
# ---------- c_script: C# ----------
    if(size == 0)
      size = 1;

    if(!string.IsNullOrEmpty(face) && size > 0 && !string.IsNullOrEmpty(content) &&
      pl.IsValid)
    {
      using (var doc = Rhino.RhinoDoc.CreateHeadless(null))
      {
        var te = doc.Objects.AddText(content, pl, size, face, bold, italics);
        var txt = doc.Objects.Find(te) as Rhino.DocObjects.TextObject;

        if(txt != null)
        {
          var tt = txt.Geometry as Rhino.Geometry.TextEntity;
          A = tt.Explode();
        }
      }
    }
# ---------- end c_script ----------
c_script_2 = CSharpScript(face=text_5, bold=boolean, size=slider, content="most", pl=end_points_2.End)  # -> out, A; inputs face: String, bold: Boolean, italics: Boolean, size: Double, content: String, pl: Plane; same code as c_script
# Change in Public Transport per hexagon
gradient_6 = Gradient(LowerLimit=0, UpperLimit=1, Parameter=graph_mapper_3, stops=[0.346: RGBA(237, 237, 255, 0), 1: RGB(0, 128, 128)])
data_13 = Data(gradient_6)
# METRIC 3
# Predicted Increase in Educational Facilities for each hexagon
gradient_7 = Gradient(LowerLimit=0, UpperLimit=1, Parameter=graph_mapper_6, stops=[0.15: RGB(255, 255, 255), 0.85: RGB(208, 0, 255)])
data_14 = Data(gradient_7)
# METRIC0
# Change in Green Space for each hexagon
gradient_8 = Gradient(
    LowerLimit=0,
    UpperLimit=1,
    Parameter=flatten(graph_mapper_5),
    stops=[0: RGB(0, 98, 0), 0.379: RGB(175, 255, 122), 0.654: RGB(255, 255, 255), 0.998: RGB(235, 235, 235), 1: RGB(255, 255, 255)])
data_15 = Data(gradient_8)
line_sdl_5 = LineSDL(Start=area_8.Centroid, Direction=Vector(0, 0, 1), Length=Slider(38, range=0..1000))
mesh_surface = MeshSurface(Surface=rectangle_4.Rectangle, UCount=number_slider_11, VCount=number_slider_11, Overhang=True, Equalize=False)
data_16 = Data(panel_36)
data_17 = Data(number_7)
data_18 = Data(panel_40)
data_19 = Data(round_to_decimal_place.Rounded)
data_20 = Data(panel_39)
data_21 = Data(panel_41)
graph_mapper_7 = GraphMapper(remap_numbers_14.Mapped, x0=0, x1=1, y0=0, y1=1, container_name="Bezier", cpx=[0, 0.25, 0.75, 1], cpy=[0, 0.25, 0.75, 1])
data_22 = Data(graph_mapper_7)
stream_filter = StreamFilter(Gate=rangevalue2_2, Stream0=data_10, Stream1=data_22, Stream2=data_8, Stream3=data_11, Stream4=data_9, Stream5=data_5)
multiplication_16 = Multiplication(A=stream_filter, B=Slider(152, range=0..1000))
stream_filter_2 = StreamFilter(Gate=rangevalue2_2, Stream0=data_18, Stream1=data_19, Stream2=data_20, Stream3=data_21, Stream4=data_16, Stream5=data_17)
deconstruct_mesh = DeconstructMesh(Mesh=mesh_surface)  # -> Vertices, Faces, Colours, Normals
end_points_3 = EndPoints(Curve=line_sdl_5)  # -> Start, End
round_to_decimal_place_3 = RoundToDecimalPlace(NumberX=stream_filter_2, DecimalPlace=Slider(2, range=0..10), RoundType=0)  # -> Rounded, Difference
deconstruct = Deconstruct(Point=deconstruct_mesh.Vertices)  # -> XComponent, YComponent, ZComponent
# METRIC1
# Change in Ratio of Amenities per hexagon
# METRIC2
gradient_9 = Gradient(LowerLimit=0, UpperLimit=1, Parameter=flatten(graph_mapper_7), stops=[0.15: RGB(255, 255, 255), 0.85: RGB(220, 0, 40)])
data_23 = Data(gradient_9)
stream_filter_3 = StreamFilter(Gate=rangevalue2_2, Stream0=data_15, Stream1=data_23, Stream2=data_13, Stream3=data_14, Stream4=data_12, Stream5=data_6)
xz_plane_4 = XZPlane(Origin=end_points_3.End)
bounds_15 = Bounds(Numbers=deconstruct.XComponent)
flip_plane_5 = FlipPlane(Plane=xz_plane_4, ReverseX=invert(False), ReverseY=invert(False), SwapAxes=invert(True))
# Predicted Budget allotment for each district
mesh_colours_2 = MeshColours(Mesh=graft(surface_6), Colours=simplify(graft(gradient_4)))
deconstruct_domain_2 = DeconstructDomain(Domain=bounds_15)  # -> Start, End
gradient_10 = Gradient(
    LowerLimit=deconstruct_domain_2.Start,
    UpperLimit=deconstruct_domain_2.End,
    Parameter=deconstruct.XComponent,
    stops=[0.15: RGB(255, 255, 255), 0.85: RGB(208, 0, 255)])
gradient_11 = Gradient(
    LowerLimit=deconstruct_domain_2.Start,
    UpperLimit=deconstruct_domain_2.End,
    Parameter=deconstruct.XComponent,
    stops=[0.138: RGB(255, 255, 255), 0.307: RGB(255, 255, 255), 0.542: RGB(79, 55, 25)])
gradient_12 = Gradient(
    LowerLimit=deconstruct_domain_2.Start,
    UpperLimit=deconstruct_domain_2.End,
    Parameter=deconstruct.XComponent,
    stops=[0.289: RGBA(255, 233, 212, 0), 0.85: RGB(255, 128, 0)])
gradient_13 = Gradient(
    LowerLimit=deconstruct_domain_2.Start,
    UpperLimit=deconstruct_domain_2.End,
    Parameter=deconstruct.XComponent,
    stops=[0: RGB(234, 38, 0), 0.25: RGB(103, 135, 191), 0.5: RGB(254, 244, 84), 0.75: RGB(255, 128, 0), 1: RGB(255, 0, 0)])
gradient_14 = Gradient(
    LowerLimit=deconstruct_domain_2.Start,
    UpperLimit=deconstruct_domain_2.End,
    Parameter=flatten(deconstruct.XComponent),
    stops=[0: RGB(0, 98, 0), 0.922: RGB(175, 255, 122), 0.969: RGB(255, 255, 255), 0.998: RGB(235, 235, 235), 1: RGB(255, 255, 255)])
gradient_15 = Gradient(
    LowerLimit=deconstruct_domain_2.Start,
    UpperLimit=deconstruct_domain_2.End,
    Parameter=flatten(deconstruct.XComponent),
    stops=[0.15: RGB(255, 255, 255), 0.85: RGB(220, 0, 40)])
gradient_16 = Gradient(
    LowerLimit=deconstruct_domain_2.Start,
    UpperLimit=deconstruct_domain_2.End,
    Parameter=deconstruct.XComponent,
    stops=[0.346: RGBA(237, 237, 255, 0), 1: RGB(0, 128, 128)])
entwine_2 = Entwine(
    Branch00=gradient_14,
    Branch01=gradient_15,
    Branch02=gradient_16,
    Branch03=gradient_10,
    Branch04=gradient_11,
    Branch05=gradient_12,
    FlattenInputs=True)  # -> simplify(Result)
surface_7 = Surface(curve_2)
tree_branch_17 = TreeBranch(Tree=entwine_2, Path=number_8, MaintainPaths=True)
area_9 = Area(Geometry=surface_7)  # -> Area, Centroid
construct_mesh = ConstructMesh(Vertices=deconstruct_mesh.Vertices, Faces=deconstruct_mesh.Faces, Colours=reverse(gradient_13))
construct_mesh_2 = ConstructMesh(Vertices=deconstruct_mesh.Vertices, Faces=deconstruct_mesh.Faces, Colours=tree_branch_17)
line_sdl_6 = LineSDL(Start=area_9.Centroid, Direction=Vector(0, 0, 1), Length=multiplication_16)
construct_domain_5 = ConstructDomain(DomainStart=0, DomainEnd=Slider(2, range=0..100))
xy_plane_3 = XYPlane(Origin=Point(0, 0, 0))
region_union_2 = RegionUnion(Curves=orient.Geometry, Plane=xy_plane_3)
end_points_4 = EndPoints(Curve=line_sdl_6)  # -> Start, graft(End)
rectangle_5 = Rectangle(Plane=area_9.Centroid, XSize=construct_domain_5, YSize=construct_domain_5, Radius=0)  # -> Rectangle, Length
list_item_27 = ListItem(List=region_union_2, Index=0, Wrap=True)

# ---- group: RH_IN:Circle
# Representation
boolean_2 = Boolean(invert(False))

# ----
stream_filter_4 = StreamFilter(Gate=boolean_2, Stream0=circle, Stream1=region_union_2)
point_in_curve_2 = PointInCurve(Point=area_3.Centroid, Curve=stream_filter_4)  # -> Relationship, Point
panel_52 = Panel(point_in_curve_2.Relationship)
member_index_2 = MemberIndex(Set=panel_52, Member="2")  # -> Index, Count
list_item_28 = ListItem(List=surface, Index=member_index_2.Index, Wrap=True)
list_item_29 = ListItem(List=gradient, Index=member_index_2.Index, Wrap=True)
mesh_colours_3 = MeshColours(Mesh=graft(list_item_28), Colours=graft(list_item_29))

# ---- group: ClassMesh
mesh_2 = Mesh(simplify(flatten(mesh_colours_3)))  # disabled

# ----
xz_plane_5 = XZPlane(Origin=end_points_4.End)
unit_z_5 = UnitZ(Factor=multiplication_16)
surface_8 = Surface(rectangle_5.Rectangle)
unit_z_6 = UnitZ(Factor=Slider(0.1, range=0..0.1))
closest_point_4 = ClosestPoint(Point=point, Cloud=area_9.Centroid)  # -> ClosestPoint, CPIndex, Distance
merge_5 = Merge(Data1=c_script.A, Data2=c_script_2.A)
move_9 = Move(Geometry=construct_mesh_2, Motion=unit_z_6)  # -> flatten(Geometry), Transform
stream_filter_5 = StreamFilter(Gate=boolean_2, Stream0=circle, Stream1=list_item_27)
extrude = Extrude(Base=surface_8, Direction=unit_z_5)
area_10 = Area(Geometry=surface_7)  # -> Area, Centroid
move_10 = Move(Geometry=merge_5, Motion=unit_z_6)  # -> Geometry, Transform
move_11 = Move(Geometry=rectangle_4.Rectangle, Motion=unit_z_6)  # -> flatten(Geometry), Transform
point_in_curve_3 = PointInCurve(Point=area_10.Centroid, Curve=stream_filter_5)  # -> Relationship, Point

# ---- group: RH_OUT:crvrect
crv_2 = Curve(simplify(flatten(move_11.Geometry)))

# ---- group: RH_OUT:Least
# Gradient mesh
curve_4 = Curve(move_10.Geometry)

# ----
panel_53 = Panel(point_in_curve_3.Relationship)
boolean_toggle = BooleanToggle(False)
member_index_3 = MemberIndex(Set=panel_53, Member="2")  # -> Index, Count
member_index_4 = MemberIndex(Set=member_index_3.Index, Member=closest_point_4.CPIndex)  # -> Index, Count
list_item_30 = ListItem(List=flatten(xz_plane_5), Index=member_index_3.Index, Wrap=True)
list_item_31 = ListItem(List=flatten(round_to_decimal_place_3.Rounded), Index=member_index_3.Index, Wrap=True)
flip_plane_6 = FlipPlane(Plane=list_item_30, ReverseX=invert(False), ReverseY=invert(False), SwapAxes=invert(True))
boolean_toggle_2 = BooleanToggle(True)
text_6 = Text("Arial")
list_item_32 = ListItem(List=surface_7, Index=member_index_3.Index, Wrap=True)
list_item_33 = ListItem(List=stream_filter_3, Index=member_index_3.Index, Wrap=True)
list_item_34 = ListItem(List=extrude, Index=member_index_3.Index, Wrap=True)
list_item_35 = ListItem(List=stream_filter_3, Index=member_index_3.Index, Wrap=True)
mesh_colours_4 = MeshColours(Mesh=graft(list_item_32), Colours=graft(list_item_33))
mesh_colours_5 = MeshColours(Mesh=graft(list_item_34), Colours=graft(list_item_35))

# ---- group: RH_IN:DisplayBudget
boolean_3 = Boolean(Toggle(True))

# ----
stream_filter_6 = StreamFilter(Gate=boolean_3, Stream0=list_item_23, Stream1=" Budget Analysis")
concatenate = Concatenate(FragmentB=text_3, FragmentA=stream_filter_6)
c_script_3 = CSharpScript(face=text_4, bold=Toggle(False), size=Slider(11, range=0..11), content=concatenate, pl=move_8.Geometry)  # -> out, A; inputs face: String, bold: Boolean, italics: Boolean, size: Double, content: String, pl: Plane; same code as c_script

# ---- group: RH_OUT:Curves
# Analysis Title
curve_5 = Curve(c_script_3.A)

# ----
stream_filter_7 = StreamFilter(Gate=boolean_3, Stream1="   //   ")
stream_filter_8 = StreamFilter(Gate=boolean_3, Stream1=" k EUR")
stream_filter_9 = StreamFilter(Gate=boolean_3, Stream1=round_to_decimal_place_2.Rounded)
concatenate_2 = Concatenate(Fragment_A=sort_text.Keys, B=stream_filter_7, A=stream_filter_9, Fragment_B=stream_filter_8)
stream_filter_10 = StreamFilter(Gate=boolean_3, Stream0=move_9.Geometry, Stream1=construct_mesh)

# ---- group: RH_OUTGradientLegend
rh_out_mesh = Mesh(stream_filter_10)

# ----
unit_z_7 = UnitZ(Factor=Slider(6, range=0..100))
stream_filter_11 = StreamFilter(Gate=boolean_3, Stream1=mesh_colours_2)
move_12 = Move(Geometry=mesh_colours_4, Motion=unit_z_7)  # -> Geometry, Transform
stream_filter_12 = StreamFilter(Gate=boolean_3, Stream1=mesh_colours_2)
move_13 = Move(Geometry=mesh_colours_5, Motion=unit_z_7)  # -> Geometry, Transform
stream_filter_13 = StreamFilter(Gate=boolean_3, Stream0=move_12.Geometry)

# ---- group: RH_OUT:dist
crv_3 = Curve(simplify(flatten(orient.Geometry)))

# ---- group: RH_OUT:BudgetMesh
mesh_3 = Mesh(simplify(stream_filter_11))

# ----
stream_filter_14 = StreamFilter(Gate=boolean_3, Stream0=move_13.Geometry)

# ---- group: RH_OUT:ColMesh
mesh_4 = Mesh(simplify(flatten(stream_filter_13)))

# ---- group: RH_OUT:ColMesh2
mesh_5 = Mesh(simplify(flatten(stream_filter_14)))

# ----
panel_54 = Panel("""Increase in green space for every 1 sq.km
Increase in Ratio of Amenities every 1 sq.km
Increase in Public Transport every 1 sq.km
Increase in Educational Facilities for every 1 sq.km
Increase in Solid Waste Generation for every 1 sq.km
Increase in Population density per hexagon for every 1 sq.km""")
construct_point_3 = ConstructPoint(XCoordinate=number_slider_9, YCoordinate=Slider(189, range=0..1000), ZCoordinate=0)
list_item_36 = ListItem(List=flatten(round_to_decimal_place_3.Rounded), Index=member_index_4.Index, Wrap=True)
list_item_37 = ListItem(List=area_9.Centroid, Index=closest_point_4.CPIndex, Wrap=True)
number_11 = Number(rangevalue2_2)
list_item_38 = ListItem(List=panel_54, Index=number_11, Wrap=True)
bool = Boolean(False)
concatenate_3 = Concatenate(A=list_item_36, C="      //    ", B=list_item_38)
c_script_4 = CSharpScript(
    face=text_6,
    bold=bool,
    italics=boolean_toggle_2,
    size=Slider(19, range=0..100),
    content=flatten(concatenate_3),
    pl=flatten(construct_point_3))  # -> out, simplify(A); inputs face: String, bold: Boolean, italics: Boolean, size: Double, content: String, pl: Plane; same code as c_script

c_script_5 = CSharpScript(
    face=text_6,
    bold=bool,
    italics=boolean_toggle_2,
    size=number_slider_6,
    content=flatten(merge_3),
    pl=flatten(flip_plane_2))  # -> out, simplify(A); inputs face: String, bold: Boolean, italics: Boolean, size: Double, content: String, pl: Plane; same code as c_script
c_script_6 = CSharpScript(
    face=text_6,
    bold=bool,
    italics=boolean_toggle_2,
    size=Slider(5, range=0..100),
    content=flatten(merge_4),
    pl=flatten(flip_plane))  # -> out, simplify(A); inputs face: String, bold: Boolean, italics: Boolean, size: Double, content: String, pl: Plane; same code as c_script
c_script_7 = CSharpScript(face=text_6, bold=bool, italics=boolean_toggle_2, size=Slider(6, range=0..10), content=entwine, pl=move_6.Geometry)  # -> out, simplify(A); inputs face: String, bold: Boolean, italics: Boolean, size: Double, content: String, pl: Plane; same code as c_script
c_script_8 = CSharpScript(
    face=text_6,
    bold=bool,
    italics=boolean_toggle_2,
    size=number_slider_6,
    content=flatten(partition_list_2),
    pl=flatten(flip_plane_4))  # -> out, simplify(A); inputs face: String, bold: Boolean, italics: Boolean, size: Double, content: String, pl: Plane; same code as c_script

# ---- group: RH_OUT:text1
crv_4 = Curve(simplify(flatten(c_script_7.A)))

# ---- group: RH_OUT:text4
crv_5 = Curve(simplify(flatten(c_script_6.A)))

# ---- group: RH_OUT:text2
crv_6 = Curve(simplify(flatten(c_script_8.A)))

# ---- group: RH_OUT:text3
crv_7 = Curve(simplify(flatten(c_script_5.A)))

# ----
c_script_9 = CSharpScript(
    face=text_6,
    bold=bool,
    italics=boolean_toggle_2,
    size=Slider(10, range=0..100),
    content=flatten(concatenate_2),
    pl=flatten(flip_plane_5))  # -> out, simplify(A); inputs face: String, bold: Boolean, italics: Boolean, size: Double, content: String, pl: Plane; same code as c_script
c_script_10 = CSharpScript(
    face=text_6,
    bold=bool,
    italics=boolean_toggle_2,
    size=Slider(5, range=0..100),
    content=flatten(list_item_31),
    pl=flatten(flip_plane_6))  # -> out, simplify(A); inputs face: String, bold: Boolean, italics: Boolean, size: Double, content: String, pl: Plane; same code as c_script
stream_filter_15 = StreamFilter(Gate=boolean_3, Stream0=c_script_4.A)
stream_filter_16 = StreamFilter(Gate=boolean_3, Stream0=c_script_10.A)

# ---- group: RH_OUT:crvsm
crv_8 = Curve(simplify(flatten(stream_filter_16)))

# ---- group: RH_OUT:crvsmq
crv_9 = Curve(simplify(flatten(stream_filter_15)))

# ----
bounding_rectangle = BoundingRectangle(Geometry=crv_9, Plane=PlaneXY(0, 0, 0), Axis=0, Slide=0, Union=True)  # -> Bounding, DimensionX, DimensionY
area_11 = Area(Geometry=bounding_rectangle.Bounding)  # -> Area, Centroid
scale_nu = ScaleNU(
    Geometry=bounding_rectangle.Bounding,
    Plane=area_11.Centroid,
    ScaleX=Slider(1.1, range=0..10),
    ScaleY=Slider(2.1, range=0..10),
    ScaleZ=1)  # -> Geometry, Transform
discontinuity = Discontinuity(Curve=scale_nu.Geometry, Level=1)  # -> Points, Parameters
list_item_39 = ListItem(List=discontinuity.Points, Index=0, Wrap=True)
line = Line(StartPoint=list_item_37, EndPoint=list_item_39)

# ---- group: RH_OUT:ca
curve_6 = Curve(scale_nu.Geometry)

# ---- group: RH_OUT:crvs
crv_10 = Curve(simplify(flatten(c_script_9.A)))

# ----
rh_out_cb = Curve(line)
